# Grasshopper definition testing_MiscToolbox.ghx (Grasshopper 0.9.76)
# plug-ins: MiscToolbox

panel = Panel("""C
test
hello""")
series = Series(Start=0, Step=1, Count=10)  # -> graft(Series)
# E:\Torrent\Series\Brooklyn99\Brooklyn.Nine-Nine.S06E12.iNTERNAL.720p.HEVC.x265-MeGusta\Screens
number_slider = Slider(259, range=0..1000)
number_slider_2 = Slider(10, range=0..10)
series_2 = Series(Start=0, Step=1, Count=10)
number_slider_3 = Slider(5, range=1..100)
series_3 = Series(Start=0, Step=1, Count=series)  # -> simplify(graft(Series))
number_slider_4 = Slider(1, range=1..100)
relpaths = RelativePaths()  # -> Grasshopper, Rhino, Current, Temp, RandomFilename
number_slider_5 = Slider(100, range=0..100)
# E:\Torrent\Series\Brooklyn99\Brooklyn.Nine-Nine.S06E12.iNTERNAL.720p.HEVC.x265-MeGusta\Brooklyn.Nine-Nine.S06E12.iNTERNAL.720p.HEVC.x265-MeGusta.mkv
panel_2 = Panel("asdf)fdfd")
norm = Normalize(Values=series_2)
jpath = JoinPathComponent(Paths=panel, FileName="file", Extention=".jpeg")
dup = DuplicateData(Data=[Toggle(False), Toggle(False)], Number=2, Order=True)
dom = ConstructDomain(DomainStart=Slider(-1, range=-1..1), DomainEnd=Slider(2, range=0..10))
decpath = DeconstructPath(Path=relpaths.Rhino)  # -> Drive, Directory, DirectoryExists, Filename, FilenameNoExtention, Extention
getbranch = GetBranch(Tree=series_3, Index=number_slider)
dom_2 = ConstructDomain(DomainStart=Slider(25, range=0..100), DomainEnd=Slider(50, range=0..100))
number_slider_6 = Slider(2, range=0..5)
random = Random(Range=number_slider_2, Number=number_slider_5, Seed=expr("x*2", number_slider_3))
random_2 = Random(Range=number_slider_2, Number=number_slider_5, Seed=expr("x*10", number_slider_3))
dom_3 = ConstructDomain(DomainStart=Slider(0, range=-1..1), DomainEnd=Slider(1, range=0..10))
random_3 = Random(Range=number_slider_2, Number=number_slider_5, Seed=number_slider_3)
random_4 = Random(Range=dom, Number=Slider(20, range=0..20), Seed=2)
random_5 = Random(Range=Domain(0, 1), Number=number_slider_5, Seed=expr("x*2", number_slider_4))
random_6 = Random(Range=Domain(0, 1), Number=number_slider_5, Seed=expr("x*10", number_slider_4))
jpath_2 = JoinPathComponent(Paths=decpath.Directory, FileName="test.st")
random_7 = Random(Range=Slider(10, range=0..10), Number=number_slider_5, Seed=number_slider_4)
panel_3 = Panel(getbranch)
massandor = MassAndOr(Values=dup)  # -> And, Or
decpath_2 = DeconstructPath(Path=panel_2)  # -> Drive, Directory, DirectoryExists, Filename, FilenameNoExtention, Extention
panel_4 = Panel(norm)
panel_5 = Panel(jpath)
pln = Plane(Plane(origin=(30.50264793, 32.04004903, 0), x=(0.8853178526, 0.4649863438, 0), y=(-0.4649863438, 0.8853178526, 0)))
geo = Geometry(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)
random_8 = Random(Range=dom_3, Number=Slider(20, range=0..20), Seed=2)
pt = ConstructPoint(XCoordinate=random_3, YCoordinate=random, ZCoordinate=random_2)
nickname = LengthDomainComponent(Domain=dom_2)
md_slider = MDSlider(slider_value=Point(0.5, 0.5, 0.5), SliderMode=0, x_domain=Domain(0, 1), y_domain=Domain(0, 1), z_domain=Domain(0, 1))
box = CenterBox(Base=pt, X=random_7, Y=random_5, Z=random_6)
evaldom = EvaluateInterval(Domain=dom_2, TParameter=Slider(0.25, range=0..1))
bbox = BoundingBox(Content=geo, Plane=pln)  # -> Box, Box_2
panel_6 = Panel([decpath_2.Drive, decpath_2.Directory, decpath_2.DirectoryExists, decpath_2.Filename, decpath_2.FilenameNoExtention, decpath_2.Extention])
con = Constrain(Value=random_4, Min=Slider(0, range=0..100), Max=Slider(1, range=0..1))
roundval = RoundValues(Value=random_4, SignificantDigits=number_slider_6)
panel_7 = Panel([massandor.And, massandor.Or])
format = FormatPercentage(Value=random_8, SignificantDigits=number_slider_6)
item = ListItem(List=random_8, Index=0, Wrap=True)  # -> Item1, Item
mesh = MeshBrep(
    Brep=box,
    Settings={GridMaxCount=0, GridMinCount=16, JaggedSeams=False, MaxEdgeLength=0, MinEdgeLength=0.0001, MinTolerance=0, Refine=True, RefineAngle=0, RelativeTolerance=0.65, SimplePlanes=True, Tolerance=0})
panel_8 = Panel(nickname)
panel_9 = Panel(evaldom)
relpaths_2 = RelativePaths()  # -> Grasshopper, Rhino, Current, Temp, RandomFilename
createenum = CreateEnumeration(Value=format)
perm = Permutations(Options=Slider(10, range=0..10), Selection=Slider(7, range=0..10), Permutation=2)  # -> Size, Permutations
symdom = SymmetricalDomain(Value=Slider(3.208, range=0..10))
valstats = ValueStats(Value=random_8)  # -> Min, Max, Average
centerbox = CenterBox(Box=bbox.Box)
intdiv = IntegerDivisors(Value=Slider(12, range=0..100))
tri = Triangulate(Mesh=mesh)  # -> graft(Mesh), Count
panel_10 = Panel(con)
relpaths_3 = RelativePaths(Update=md_slider)  # -> Grasshopper, Rhino, Current, Temp, RandomFilename
panel_11 = Panel([relpaths_2.Grasshopper, relpaths_2.Rhino, relpaths_2.Current, relpaths_2.Temp, relpaths_2.RandomFilename])
panel_12 = Panel(symdom)
number_slider_7 = Slider(1000, range=0..1000)
panel_13 = Panel([valstats.Min, valstats.Max, valstats.Average])
panel_14 = Panel(intdiv)
panel_15 = Panel([perm.Size, perm.Permutations])
bbox_2 = BoundingBox(Content=tri.Mesh, Plane=PlaneXY(0, 0, 0))  # -> Box, Box_2
decpath_3 = DeconstructPath(Path=relpaths_3.Rhino)  # -> Drive, Directory, DirectoryExists, Filename, FilenameNoExtention, Extention
mesh_2 = Mesh(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)
pt_2 = Point([Point(-18.59768865, 103.3390856, 0), Point(-28.11378201, -31.17088838, 0)])
mesh_3 = Mesh([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])
mesh_4 = Mesh(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)
vec = Vector([Vector(16.77243159, 22.53089102, 0), Vector(-8.530874526, 47.30070936, 0)])
rndred = RandomReduce(Data=flatten(bbox_2.Box), Percentage=Slider(1, range=0..1), Seed=0)
arraygeometry = ArrayGeometry(Geometry=bbox_2.Box, Spacing=Slider(1, range=0..10), Type=2)
panel_16 = Panel(roundval)
jpath_3 = JoinPathComponent(Paths=decpath_3.Directory, FileName="serialisation.ghx")
popgeo = PopulateGeometry(Geometry=mesh_4, Count=number_slider_7, Seed=1)
pt_3 = Point(Point(44.63340333, -56.00935972, 0))
pln_2 = Plane(Plane(origin=(44.63352914, -56.01616066, 0), x=(0.6080243982, 0.7939183404, 0), y=(-0.7700314845, 0.5897305883, 0.2434529646)))
vec_2 = Vector(Vector(-8.3974432, 16.9101956, 0))
vec_3 = Vector([Vector(-9.296670021, 12.48862473, 0), Vector(-7.612728868, 13.41261504, 0), Vector(-5.824299052, 14.45089914, 0), Vector(-3.67804863, 14.64530089, 0), Vector(-1.312300048, 14.58900572, 0), Vector(0.8528152339, 14.42998195, 0), Vector(3.323426444, 14.36604395, 0), Vector(6.226356041, 13.56580046, 0), Vector(8.712970462, 12.68067391, 0), Vector(10.3847559, 11.04305981, 0), Vector(11.94676931, 9.192657426, 0), Vector(13.90863053, 6.868584745, 0)])
vdis = VectorDisplay(Anchor=pt_2, Vector=vec)
popgeo_2 = PopulateGeometry(Geometry=mesh_2, Count=number_slider_7, Seed=1)
box_2 = Box({Plane=PlaneXY(0, 0, 0), X=Domain(-7.751377659, 23.23057235), Y=Domain(13.37005732, 42.99242164), Z=Domain(0, 0)})
viewer = ParamViewer(rndred)
crv = Curve(reparameterize(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))
mjoin = MeshJoin(Meshes=mesh_3)
panel_17 = Panel(format)
geo_2 = Geometry(arraygeometry)
pt_4 = Point(Point(357.8600712, 281.0433642, 0))
dup_2 = DuplicateData(Data=pt_3, Number="1000", Order=True)
rec = Rectangle(box_2)
pl = ConstructPlane(Origin=Point(0, 0, 0), XAxis=Vector(1, 0, 0), YAxis=Vector(0, 1, 0))
dup_3 = DuplicateData(Data=pln_2, Number="1000", Order=True)
pi = Pi(Factor=Slider(0.26, range=-1..2))
geo_3 = Geometry([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])
lng = ListLength(List=vec_3)
entwine = Entwine(Branch00=popgeo, Branch01=popgeo_2, FlattenInputs=True)
drec = DeconstuctRectangle(Rectangle=rec)  # -> BasePlane, XInterval, YInterval
savearchive = SaveArchive(P=jpath_3, OriginalCubes=bbox_2.Box, Reduced=rndred, Meshes=mesh, Grid=arraygeometry, binary=True)
vec_4 = Vector(Vector(8.683420625, 11.37981628, 0))
range = Range(Domain=Domain(0, 1), Steps=Slider(30, range=0..1000))
rebaserect = RebaseRectangle3d(Rectangle=rec)
panel_18 = Panel(createenum)
random_9 = Random(Range=Domain(0, 1), Number=lng, Seed=2)
vdis_2 = VectorDisplay(Anchor=pt_4, Vector=vec_4)
pl_2 = PlaneNormal(Origin=pt_3, ZAxis=vec_2)
item_2 = ListItem(List=geo_3, Index=0, Wrap=True)
meshpoint = MeshPointIntersectionsParallel(
    Mesh=mesh_3,
    TargetMesh=[mesh_4, mesh_2],
    Point=pt_2,
    Normal=vec,
    Target=entwine,
    Angle=pi,
    Run=Toggle(True),
    distDebug=False,
    hitsDebug=False,
    raysDebug=True)  # -> Intersections, Ray, Distance, Hit
loadarchive = LoadArchive(Path=savearchive)  # -> OriginalCubes, Reduced, Meshes, Grid
centerline = CenterLine(Center=pt_4, Direction=vec_4, Length=Slider(283, range=0..1710))
drec_2 = DeconstuctRectangle(Rectangle=rebaserect)  # -> BasePlane, XInterval, YInterval
eval = EvaluateCurve(Curve=reparameterize(crv), Parameter=range)  # -> Point, Tangent, Angle
panel_19 = Panel("""{200, 80, 0}
{160, 82, 0}
{163, 197, 0}
{328, 279, 0}""")
panel_20 = Panel("""{164, 107  , 0}
{53,  90, 0}""")
minbb = MinVolumeBoundingBox(Geometry=geo_3, Degrees=Slider(1, range=0.01..2), Plane=PlaneXY(0, 0, 0), Rotate_X=True, Rotate_Y=True, Rotate_Z=True)
meshray = MeshRayInteresectionParallel(
    Mesh=mesh_3,
    Point=dup_2,
    Normal=dup_3,
    Vectors=vec_3,
    Weights=random_9,
    Run="-1",
    Run_2=Toggle(True),
    distDebug=True,
    hitsDebug=False,
    IndexDebug=False,
    raysDebug=True,
    vectorsDebug=True)  # -> Results, Values, Intersections, Ray, Distance, Hit, Vectors
viewer_2 = ParamViewer()
panel_21 = Panel("""{164, 82  , 0}
{36, 115, 0}""")
panel_22 = Panel(""" {164, 82, 0}
{170, 114, 0}
{164, 82, 0} 
{170, 115, 0}
 {164, 82, 0}
{170, 115, 0}""")
line = Line(centerline)
end = EndPoints(Curve=centerline)  # -> Start, End
crossref = CrossReference(ListA=eval.Point, ListB=eval.Point, CrossMode=5)  # -> ListA, ListB
cull = CullPattern(CullPattern=[False, False, True, True])
cull_2 = CullPattern(CullPattern=invert([False, False, True, True]))
centerbox_2 = CenterBox(Box=minbb)
boxprop = BoxProperties(Box=minbb)  # -> Center, Diagonal, Area, Volume, Degeneracy
box_3 = Box(minbb)
vdis_3 = VectorDisplay(Anchor=pt_3, Vector=expr("x*100", meshray.Vectors))
vdis_4 = VectorDisplay(Anchor=pt_3, Vector=vec_2)
vdis_5 = VectorDisplay(Anchor=pl, Vector=vec_3)
ln = Line(StartPoint=crossref.ListA, EndPoint=crossref.ListB)
crv_2 = Curve(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)
pt_5 = Point(panel_19)
panel_23 = Panel(meshpoint.Intersections)
pt_6 = Point(panel_20)
pln_3 = Plane([minbb, centerbox_2])
panel_24 = Panel(meshray.Results)
item_3 = ListItem(List=pt_6, Index=0, Wrap=True)  # -> Item, Item1
pline = PolyLine(Vertices=pt_5, Closed=Toggle(True))
crv_3 = Curve(reparameterize(ln))
panel_25 = Panel(meshpoint.Ray)
pdecon = Deconstruct(Point=item_3.Item1)  # -> XComponent, YComponent, ZComponent
panel_26 = Panel(meshray.Values)
insrect = InscribedRectangle(Boundary=crv, Curve=crv_3)  # -> Curve, Area, Polyline
insrect_2 = InscribedRectangle(Boundary=pline)
rectangle = Rectangle(Plane=item_3.Item, XSize=pdecon.XComponent, YSize=pdecon.YComponent, Radius=0)  # -> Rectangle, Length
panel_27 = Panel(meshray.Distance)
panel_28 = Panel(meshpoint.Distance)
end_2 = EndPoints(Curve=insrect_2)  # -> Start, End
sort = SortList(Keys=insrect.Area, ValuesA=insrect.Polyline)  # -> Keys, ValuesA
panel_29 = Panel(meshray.Ray)
panel_30 = Panel(meshray.Intersections)
panel_31 = Panel([end_2.Start, end_2.End])
panel_32 = Panel(meshpoint.Hit)
item_4 = ListItem(List=reverse(sort.ValuesA), Index=0, Wrap=True)
panel_33 = Panel(meshray.Hit)
